# Dynamo graph Exterior.v6.dyn (Dynamo 2.10.1.3976)
# packages: Clockwork for Dynamo 2.x 2.3.0

# group: Calling Plumbing Fixtures Families and Instances
categories = Categories("OST_PlumbingFixtures")
all_family_types_of_category = Custom[All Family Types Of Category](category=categories)  # package Clockwork for Dynamo 2.x; Gets all family types/symbols of a given category in the model.
familyName = Custom[FamilyType.FamilyName](familyType=all_family_types_of_category)  # package Clockwork for Dynamo 2.x; Returns the *family* name of a given family *type*
code_block = CodeBlock { "T12"; }
contains = String.Contains(str=familyName, searchFor=code_block)
filterByBoolMask = List.FilterByBoolMask(list=all_family_types_of_category, mask=contains)
all_elements_of_family_type = Custom[All Elements of Family Type+](familyType=filterByBoolMask.in)  # package Clockwork for Dynamo 2.x; Unlike the built-in node, this node retrieves all placed instances of a given loadable *or* system family type

# group: Calling Pipe Families and Instances
categories_2 = Categories("OST_PipeCurves")
all_family_types_of_category_2 = Custom[All Family Types Of Category](category=categories_2)
name = FamilyType.Name(familyType=all_family_types_of_category_2)
code_block_2 = CodeBlock { "T12"; }
contains_2 = String.Contains(str=name, searchFor=code_block_2)
filterByBoolMask_2 = List.FilterByBoolMask(list=all_family_types_of_category_2, mask=contains_2)
all_elements_of_family_type_2 = Custom[All Elements of Family Type+](familyType=filterByBoolMask_2.in)

# group: Calling Wall Families and Instances
categories_3 = Categories("OST_Walls")
all_family_types_of_category_3 = Custom[All Family Types Of Category](category=categories_3)
name_2 = FamilyType.Name(familyType=all_family_types_of_category_3)
code_block_3 = CodeBlock { "T12"; }
contains_3 = String.Contains(str=name_2, searchFor=code_block_3)
filterByBoolMask_3 = List.FilterByBoolMask(list=all_family_types_of_category_3, mask=contains_3)
all_elements_of_family_type_3 = Custom[All Elements of Family Type+](familyType=filterByBoolMask_3.in)

code_block_4 = CodeBlock { " "; "Walls"; "Windows"; "Doors"; "Studs"; "Stud Connections"; }
list_create = List.Create(item0=code_block_4.out0, item1=code_block_4.out1, item2=code_block_4.out2, item3=code_block_4.out3, item4=code_block_4.out4, item5=code_block_4.out5)
code_block_5 = CodeBlock { "D Score"; }
addItemToFront = List.AddItemToFront(item=code_block_5)  # unwired: list
code_block_6 = CodeBlock { "R Score"; }
addItemToFront_2 = List.AddItemToFront(item=code_block_6)  # unwired: list
code_block_7 = CodeBlock { "DAS Score"; }
addItemToFront_3 = List.AddItemToFront(item=code_block_7)  # unwired: list
list_create_2 = List.Create(item0=list_create, item1=addItemToFront, item2=addItemToFront_2, item3=addItemToFront_3)
transpose = List.Transpose(lists=addItemToFront_3@@L2)
watch = Watch(transpose)
file_path = Filename("..\csvoutput.csv")
exportCSV = Data.ExportCSV(filePath=file_path@@L1)  # unwired: data
watch_2 = Watch(exportCSV)

# group: Exterior_Windows
categories_4 = Categories("OST_Windows")
all_family_types_of_category_4 = Custom[All Family Types Of Category](category=categories_4)
string_from_object = FromObject(object=all_family_types_of_category_4)
code_block_8 = CodeBlock { "DAS"; }
contains_4 = String.Contains(str=string_from_object, searchFor=code_block_8)
filterByBoolMask_4 = List.FilterByBoolMask(list=all_family_types_of_category_4, mask=contains_4)
all_elements_of_family_type_4 = ElementsOfFamilyType(Family_Type=all_family_types_of_category_4)

# group: Exterior_Doors
categories_5 = Categories("OST_Doors")
all_family_types_of_category_5 = Custom[All Family Types Of Category](category=categories_5)
string_from_object_2 = FromObject(object=all_family_types_of_category_5)
code_block_9 = CodeBlock { "DAS"; }
contains_5 = String.Contains(str=string_from_object_2, searchFor=code_block_9)
filterByBoolMask_5 = List.FilterByBoolMask(list=all_family_types_of_category_5, mask=contains_5)
all_elements_of_family_type_5 = ElementsOfFamilyType(Family_Type=all_family_types_of_category_5)

# group: Exterior Walls Cladding
categories_6 = Categories("OST_CurtainWallPanels")
all_family_types_of_category_6 = Custom[All Family Types Of Category](category=categories_6)
name_3 = FamilyType.Name(familyType=all_family_types_of_category_6)
code_block_10 = CodeBlock { "DAS_Cladding"; }
contains_6 = String.Contains(str=name_3, searchFor=code_block_10)
filterByBoolMask_6 = List.FilterByBoolMask(list=all_family_types_of_category_6, mask=contains_6)
string = StringInput("Area")

# group: Exterior Insulation
categories_7 = Categories("OST_CurtainWallPanels")
all_family_types_of_category_7 = Custom[All Family Types Of Category](category=categories_7)
name_4 = FamilyType.Name(familyType=all_family_types_of_category_7)
code_block_11 = CodeBlock { "DAS_Insulation"; }
contains_7 = String.Contains(str=name_4, searchFor=code_block_11)
filterByBoolMask_7 = List.FilterByBoolMask(list=all_family_types_of_category_7, mask=contains_7)
all_elements_of_family_type_6 = Custom[All Elements of Family Type+](familyType=all_family_types_of_category_7)
string_2 = StringInput("Area")
getParameterValueByName = Element.GetParameterValueByName(element=all_elements_of_family_type_6, parameterName=string_2)

# group: Exterior_WallStuds
categories_8 = Categories("OST_CurtainWallPanels")
all_family_types_of_category_8 = Custom[All Family Types Of Category](category=categories_8)
name_5 = FamilyType.Name(familyType=all_family_types_of_category_8)
code_block_12 = CodeBlock { "DAS_Stud"; }
contains_8 = String.Contains(str=name_5, searchFor=code_block_12)
filterByBoolMask_8 = List.FilterByBoolMask(list=all_family_types_of_category_8, mask=contains_8)
all_elements_of_family_type_7 = Custom[All Elements of Family Type+](familyType=all_family_types_of_category_8)
string_3 = StringInput("Length")
getParameterValueByName_2 = Element.GetParameterValueByName(element=all_elements_of_family_type_7, parameterName=string_3)
code_block_13 = CodeBlock(item=getParameterValueByName_2) { item!="" ? item:0; }

# group: Exterior_Sheathing
categories_9 = Categories("OST_Walls")
all_family_types_of_category_9 = Custom[All Family Types Of Category](category=categories_9)
name_6 = FamilyType.Name(familyType=all_family_types_of_category_9)
code_block_14 = CodeBlock { "DAS_Sheathing"; }
contains_9 = String.Contains(str=name_6, searchFor=code_block_14)
filterByBoolMask_9 = List.FilterByBoolMask(list=all_family_types_of_category_9, mask=contains_9)
all_elements_of_family_type_8 = Custom[All Elements of Family Type+](familyType=all_family_types_of_category_9)

flatten = List.Flatten(list=all_elements_of_family_type_4)

# group (continued): Exterior_Windows
count = List.Count(list=flatten)

flatten_2 = List.Flatten(list=all_elements_of_family_type_5)

# group (continued): Exterior_Doors
count_2 = List.Count(list=flatten_2)

code_block_15 = CodeBlock { "DAS_Cladding_Fiber"; }
contains_10 = String.Contains(str=name_3, searchFor=code_block_15)
filterByBoolMask_10 = List.FilterByBoolMask(list=all_family_types_of_category_6, mask=contains_10)

# group (continued): Exterior Walls Cladding
all_elements_of_family_type_9 = Custom[All Elements of Family Type+](familyType=filterByBoolMask_10.in)
getParameterValueByName_3 = Element.GetParameterValueByName(element=all_elements_of_family_type_9, parameterName=string)
code_block_16 = CodeBlock(item=getParameterValueByName_3) { item!="" ? item:0; }

flatten_3 = List.Flatten(list=code_block_16)

# group (continued): Exterior Walls Cladding
sum = Math.Sum(values=flatten_3)

code_block_17 = CodeBlock(a=sum) { b=a*2; }

# group: Families & Quantities
list_create_3 = List.Create(item0=filterByBoolMask_4.in, item1=filterByBoolMask_5.in, item2=filterByBoolMask_6.in, item3=filterByBoolMask_7.in, item4=filterByBoolMask_8.in, item5=filterByBoolMask_9.in)
list_create_4 = List.Create(item0=count, item1=count_2, item2=sum, item3=sum, item4=sum, item5=code_block_17)

name_7 = Family.Name(family=list_create_3)

# group: Parameter Value Generator
code_block_18 = CodeBlock(Family_List=list_create_3)
# ---------- code_block_18.designscript (8 lines) ----------
D_Conn = Elements.GetParameterValueByNameTypeOrInstance(Family_List, "DECONST_Connection_Type");
D_Move = Elements.GetParameterValueByNameTypeOrInstance(Family_List, "DECONST_Moveability");
D_Pref = Elements.GetParameterValueByNameTypeOrInstance(Family_List, "DECONST_Prefabrication");
D_Tool = Elements.GetParameterValueByNameTypeOrInstance(Family_List, "DECONST_Tools");
R_Ruse = Elements.GetParameterValueByNameTypeOrInstance(Family_List, "RECOVER_Reusability");
R_Secf = Elements.GetParameterValueByNameTypeOrInstance(Family_List, "RECOVER_Secondary_Finishing");
R_Toxi = Elements.GetParameterValueByNameTypeOrInstance(Family_List, "RECOVER_Toxicity");
R_Recy = Elements.GetParameterValueByNameTypeOrInstance(Family_List, "RECOVER_Recyclability");
# ----------------------------------------

# group: Scoring & Weighting Dictionary
file_path_2 = Filename(".\Dictionary.xlsx")
file_from_path = FileObject(path=file_path_2)
code_block_19 = CodeBlock { "Scores_Original_DAS"; "Exterior"; }
code_block_20 = CodeBlock { 0; 1; }
importExcel = Data.ImportExcel(file=file_from_path, sheetName=code_block_19.out0)
getItemAtIndex = List.GetItemAtIndex(list=importExcel, index=code_block_20.out0)
getItemAtIndex_2 = List.GetItemAtIndex(list=importExcel, index=code_block_20.out1)
byKeysValues = DesignScript.Builtin.Dictionary.ByKeysValues(keys=getItemAtIndex, values=getItemAtIndex_2)
valueAtKey = DesignScript.Builtin.Dictionary.ValueAtKey(dictionary=byKeysValues, key=code_block_18.D_Conn)

importExcel_2 = Data.ImportExcel(file=file_from_path, sheetName=code_block_19.out1)
getItemAtIndex_3 = List.GetItemAtIndex(list=importExcel_2, index=code_block_20.out0)
getItemAtIndex_4 = List.GetItemAtIndex(list=importExcel_2, index=code_block_20.out1)
byKeysValues_2 = DesignScript.Builtin.Dictionary.ByKeysValues(keys=getItemAtIndex_3, values=getItemAtIndex_4)
valueAtKey_2 = DesignScript.Builtin.Dictionary.ValueAtKey(dictionary=byKeysValues_2, key=name_7)
code_block_21 = CodeBlock(dictionary1=byKeysValues, t1=code_block_18.D_Move) { t2 = Dictionary.ValueAtKey(dictionary1, t1); }
valueAtKey_3 = DesignScript.Builtin.Dictionary.ValueAtKey(dictionary=byKeysValues, key=code_block_18.D_Tool)
code_block_22 = CodeBlock(b=code_block_18.R_Secf, d=code_block_18.R_Toxi) { a=1-b; c=1-d; }
python_script = Python(IN[0]=name_7, IN[1]=valueAtKey_2, IN[2]=list_create_4, IN[3]=code_block_18.D_Conn, IN[4]=valueAtKey, IN[5]=code_block_21, IN[6]=code_block_18.D_Pref, IN[7]=valueAtKey_3, IN[8]=code_block_18.R_Ruse, IN[9]=code_block_22.a, IN[10]=code_block_22.c, IN[11]=code_block_18.R_Recy)  # CPython3
# ---------- python_script.python (36 lines) ----------
# Load the Python Standard and DesignScript Libraries
import sys
import clr
import csv
clr.AddReference('ProtoGeometry')
from Autodesk.DesignScript.Geometry import *
import System
from System.IO import Directory

# The inputs to this node will be stored as a list in the IN variables.
dataEnteringNode = IN

# Place your code below this line
dir="D:\\aa\\Original_DAS"
filename=(str("Exterior"+".csv"))
output=[]
parameters=[]
j=0
for categories in IN[0]:
   i=0
   for families in categories:
      #if j!=1:
      output.append([IN[k][j][i] for k in range(2)]+[IN[2][j]]+[IN[k][j][i] for k in range(3,12)])
      #if j==1:
#         output.append([IN[k][j][i] for k in range(11)]+[IN[11][i]]+[IN[12][i]])
      i=i+1
   j=j+1
      
with open(dir+"\\"+filename,'w',newline='') as fd:
   writer=csv.writer(fd)
   for x in output:
      writer.writerow(x)  
   
   
# Assidgn your output to the OUT variable.
OUT = output
# ----------------------------------------
watch_3 = Watch(python_script)
code_block_23 = CodeBlock { Con_Type=["PU foam","Mortar","Screwed","Dowel","Fixed","Bolted","Nailed"]; }
watch_4 = Watch(valueAtKey_2)
watch_5 = Watch(valueAtKey)
watch_6 = Watch(name_7)
watch_7 = Watch(list_create_3)
string_4 = StringInput("Area")
getParameterValueByName_4 = Element.GetParameterValueByName(element=all_elements_of_family_type_8, parameterName=string_4)
code_block_24 = CodeBlock(item=getParameterValueByName_4) { item!="" ? item:0; }

# group (continued): Exterior_Sheathing
count_3 = List.Count(list=code_block_24)

flatten_4 = List.Flatten(list=code_block_13)

# group (continued): Exterior_WallStuds
sum_2 = Math.Sum(values=flatten_4)

code_block_25 = CodeBlock(item=getParameterValueByName) { item!="" ? item:0; }
flatten_5 = List.Flatten(list=code_block_25)

# group (continued): Exterior Insulation
sum_3 = Math.Sum(values=flatten_5)

watch_8 = Watch()  # unwired: arg0
watch_9 = Watch(list_create_4)
watch_10 = Watch(flatten)
watch_11 = Watch(name_5)
categories_10 = Categories()  # nothing selected
