# Dynamo graph Floor.v6.dyn (Dynamo 2.10.1.3976)
# packages: Clockwork for Dynamo 2.x 2.3.0

# group: Calling Plumbing Fixtures Families and Instances
categories = Categories("OST_PlumbingFixtures")
all_family_types_of_category = Custom[All Family Types Of Category](category=categories)  # package Clockwork for Dynamo 2.x; Gets all family types/symbols of a given category in the model.
familyName = Custom[FamilyType.FamilyName](familyType=all_family_types_of_category)  # package Clockwork for Dynamo 2.x; Returns the *family* name of a given family *type*
code_block = CodeBlock { "T12"; }
contains = String.Contains(str=familyName, searchFor=code_block)
filterByBoolMask = List.FilterByBoolMask(list=all_family_types_of_category, mask=contains)
all_elements_of_family_type = Custom[All Elements of Family Type+](familyType=filterByBoolMask.in)  # package Clockwork for Dynamo 2.x; Unlike the built-in node, this node retrieves all placed instances of a given loadable *or* system family type

# group: Calling Pipe Families and Instances
categories_2 = Categories("OST_PipeCurves")
all_family_types_of_category_2 = Custom[All Family Types Of Category](category=categories_2)
name = FamilyType.Name(familyType=all_family_types_of_category_2)
code_block_2 = CodeBlock { "T12"; }
contains_2 = String.Contains(str=name, searchFor=code_block_2)
filterByBoolMask_2 = List.FilterByBoolMask(list=all_family_types_of_category_2, mask=contains_2)
all_elements_of_family_type_2 = Custom[All Elements of Family Type+](familyType=filterByBoolMask_2.in)

# group: Calling Wall Families and Instances
categories_3 = Categories("OST_Walls")
all_family_types_of_category_3 = Custom[All Family Types Of Category](category=categories_3)
name_2 = FamilyType.Name(familyType=all_family_types_of_category_3)
code_block_3 = CodeBlock { "T12"; }
contains_3 = String.Contains(str=name_2, searchFor=code_block_3)
filterByBoolMask_3 = List.FilterByBoolMask(list=all_family_types_of_category_3, mask=contains_3)
all_elements_of_family_type_3 = Custom[All Elements of Family Type+](familyType=filterByBoolMask_3.in)

watch = Watch()  # unwired: arg0
categories_4 = Categories("OST_CurtainWallPanels")
all_family_types_of_category_4 = Custom[All Family Types Of Category](category=categories_4)
name_3 = FamilyType.Name(familyType=all_family_types_of_category_4)
code_block_4 = CodeBlock { "Stud"; }
contains_4 = String.Contains(str=name_3, searchFor=code_block_4)
filterByBoolMask_4 = List.FilterByBoolMask(list=all_family_types_of_category_4, mask=contains_4)
all_elements_of_family_type_4 = Custom[All Elements of Family Type+](familyType=filterByBoolMask_4.in)
string = StringInput("Length")
getParameterValueByName = Element.GetParameterValueByName(element=all_elements_of_family_type_4, parameterName=string)
watch_2 = Watch(getParameterValueByName)
code_block_5 = CodeBlock(item=getParameterValueByName) { item!="" ? item:0; }
sum = Math.Sum(values=code_block_5)
watch_3 = Watch(name_3)
watch_4 = Watch(filterByBoolMask_4.in)
string_from_object = FromObject(object=all_family_types_of_category_4)
watch_5 = Watch()  # unwired: arg0
watch_6 = Watch()  # unwired: arg0
code_block_6 = CodeBlock(item=getParameterValueByName) { item!="" ? item:0; }

# group: Floor Finishing
categories_5 = Categories("OST_Floors")
all_family_types_of_category_5 = Custom[All Family Types Of Category](category=categories_5)
all_elements_of_family_type_5 = Custom[All Elements of Family Type+](familyType=all_family_types_of_category_5)
string_2 = StringInput("Area")
getParameterValueByName_2 = Element.GetParameterValueByName(element=all_elements_of_family_type_5, parameterName=string_2)
string_from_object_2 = FromObject(object=all_family_types_of_category_5)
code_block_7 = CodeBlock { "DAS_FloorFinishing"; }
contains_5 = String.Contains(str=string_from_object_2, searchFor=code_block_7)
filterByBoolMask_5 = List.FilterByBoolMask(list=all_family_types_of_category_5, mask=contains_5)

flatten = List.Flatten(list=getParameterValueByName_2)

# group (continued): Floor Finishing
sum_2 = Math.Sum(values=flatten)

# group: Floor Structure Ground
categories_6 = Categories("OST_Floors")
all_family_types_of_category_6 = Custom[All Family Types Of Category](category=categories_6)
code_block_8 = CodeBlock { "Ground"; }

string_from_object_3 = FromObject(object=all_family_types_of_category_6)

# group (continued): Floor Structure Ground
contains_6 = String.Contains(str=string_from_object_3, searchFor=code_block_8)
filterByBoolMask_6 = List.FilterByBoolMask(list=all_family_types_of_category_6, mask=contains_6)

# group: Floor Structure 1st Floor
categories_7 = Categories("OST_Floors")
all_family_types_of_category_7 = Custom[All Family Types Of Category](category=categories_7)
code_block_9 = CodeBlock { "DAS_FloorStructure"; }
string_3 = StringInput("Area")

name_4 = FamilyType.Name(familyType=all_family_types_of_category_7)

# group (continued): Floor Structure 1st Floor
contains_7 = String.Contains(str=name_4, searchFor=code_block_9)
filterByBoolMask_7 = List.FilterByBoolMask(list=all_family_types_of_category_7, mask=contains_7)

# group: Joists
categories_8 = Categories("OST_StructuralFraming")
all_family_types_of_category_8 = Custom[All Family Types Of Category](category=categories_8)
name_5 = FamilyType.Name(familyType=all_family_types_of_category_8)
code_block_10 = CodeBlock { "DAS"; "M_K"; }
contains_8 = String.Contains(str=name_5, searchFor=code_block_10.out0)
filterByBoolMask_8 = List.FilterByBoolMask(list=all_family_types_of_category_8, mask=contains_8)
sum_3 = Math.Sum()  # unwired: values
string_4 = StringInput("Length")

code_block_11 = CodeBlock { "Slab on Grade"; }
contains_9 = String.Contains(str=string_from_object_3, searchFor=code_block_11)
filterByBoolMask_9 = List.FilterByBoolMask(list=all_family_types_of_category_6, mask=contains_9)

# group (continued): Floor Structure Ground
all_elements_of_family_type_6 = Custom[All Elements of Family Type+](familyType=filterByBoolMask_9.in)

string_5 = StringInput("Area")
getParameterValueByName_3 = Element.GetParameterValueByName(element=all_elements_of_family_type_6, parameterName=string_5)
flatten_2 = List.Flatten(list=getParameterValueByName_3)
sum_4 = Math.Sum(values=flatten_2)
categories_9 = Categories("OST_Roofs")
all_family_types_of_category_9 = Custom[All Family Types Of Category](category=categories_9)
name_6 = FamilyType.Name(familyType=all_family_types_of_category_9)
code_block_12 = CodeBlock { "1st Floor"; }
contains_10 = String.Contains(str=name_6, searchFor=code_block_12)
filterByBoolMask_10 = List.FilterByBoolMask(list=all_family_types_of_category_9, mask=contains_10)
contains_11 = String.Contains(str=name_4, searchFor=code_block_12)
filterByBoolMask_11 = List.FilterByBoolMask(list=all_family_types_of_category_7, mask=contains_11)
list_create = List.Create(item0=filterByBoolMask_10.in, item1=filterByBoolMask_11.in)
flatten_3 = List.Flatten(list=list_create)
all_elements_of_family_type_7 = Custom[All Elements of Family Type+](familyType=flatten_3)

# group (continued): Floor Structure 1st Floor
getParameterValueByName_4 = Element.GetParameterValueByName(element=all_elements_of_family_type_7, parameterName=string_3)

flatten_4 = List.Flatten(list=getParameterValueByName_4)

# group (continued): Floor Structure 1st Floor
sum_5 = Math.Sum(values=flatten_4)

add = sum_4 + sum_5
code_block_13 = CodeBlock { b=(17*7+26*5)*8.57; }

# group: Families & Quantities
list_create_2 = List.Create(item0=filterByBoolMask_6.in, item1=filterByBoolMask_7.in, item2=filterByBoolMask_5.in, item3=filterByBoolMask_8.in)
list_create_3 = List.Create(item0=sum_4, item1=sum_5, item2=add, item3=code_block_13)

watch_7 = Watch(list_create_2)
watch_8 = Watch(list_create_3)
watch_9 = Watch(list_create_2)
name_7 = Family.Name(family=list_create_2)

# group: Parameter Value Generator
code_block_14 = CodeBlock(Family_List=list_create_2)
# ---------- code_block_14.designscript (8 lines) ----------
D_Conn = Elements.GetParameterValueByNameTypeOrInstance(Family_List, "DECONST_Connection_Type");
D_Move = Elements.GetParameterValueByNameTypeOrInstance(Family_List, "DECONST_Moveability");
D_Pref = Elements.GetParameterValueByNameTypeOrInstance(Family_List, "DECONST_Prefabrication");
D_Tool = Elements.GetParameterValueByNameTypeOrInstance(Family_List, "DECONST_Tools");
R_Ruse = Elements.GetParameterValueByNameTypeOrInstance(Family_List, "RECOVER_Reusability");
R_Secf = Elements.GetParameterValueByNameTypeOrInstance(Family_List, "RECOVER_Secondary_Finishing");
R_Toxi = Elements.GetParameterValueByNameTypeOrInstance(Family_List, "RECOVER_Toxicity");
R_Recy = Elements.GetParameterValueByNameTypeOrInstance(Family_List, "RECOVER_Recyclability");
# ----------------------------------------

# group: Scoring & Weighting Dictionary
file_path = Filename(".\Dictionary.xlsx")
file_from_path = FileObject(path=file_path)
code_block_15 = CodeBlock { "Scores_Original_DAS"; "Floor"; }
code_block_16 = CodeBlock { 0; 1; }
importExcel = Data.ImportExcel(file=file_from_path, sheetName=code_block_15.out0)
getItemAtIndex = List.GetItemAtIndex(list=importExcel, index=code_block_16.out0)
getItemAtIndex_2 = List.GetItemAtIndex(list=importExcel, index=code_block_16.out1)
byKeysValues = DesignScript.Builtin.Dictionary.ByKeysValues(keys=getItemAtIndex, values=getItemAtIndex_2)
valueAtKey = DesignScript.Builtin.Dictionary.ValueAtKey(dictionary=byKeysValues, key=code_block_14.D_Conn)

importExcel_2 = Data.ImportExcel(file=file_from_path, sheetName=code_block_15.out1)
getItemAtIndex_3 = List.GetItemAtIndex(list=importExcel_2, index=code_block_16.out0)
getItemAtIndex_4 = List.GetItemAtIndex(list=importExcel_2, index=code_block_16.out1)
byKeysValues_2 = DesignScript.Builtin.Dictionary.ByKeysValues(keys=getItemAtIndex_3, values=getItemAtIndex_4)
valueAtKey_2 = DesignScript.Builtin.Dictionary.ValueAtKey(dictionary=byKeysValues_2, key=name_7)
watch_10 = Watch(valueAtKey_2)
code_block_17 = CodeBlock(dictionary1=byKeysValues, t1=code_block_14.D_Move) { t2 = Dictionary.ValueAtKey(dictionary1, t1); }
valueAtKey_3 = DesignScript.Builtin.Dictionary.ValueAtKey(dictionary=byKeysValues, key=code_block_14.D_Tool)
code_block_18 = CodeBlock(b=code_block_14.R_Secf, d=code_block_14.R_Toxi) { a=1-b; c=1-d; }
python_script = Python(IN[0]=name_7, IN[1]=valueAtKey_2, IN[2]=list_create_3, IN[3]=code_block_14.D_Conn, IN[4]=valueAtKey, IN[5]=code_block_17, IN[6]=code_block_14.D_Pref, IN[7]=valueAtKey_3, IN[8]=code_block_14.R_Ruse, IN[9]=code_block_18.a, IN[10]=code_block_18.c, IN[11]=code_block_14.R_Recy)  # CPython3
# ---------- python_script.python (36 lines) ----------
# Load the Python Standard and DesignScript Libraries
import sys
import clr
import csv
clr.AddReference('ProtoGeometry')
from Autodesk.DesignScript.Geometry import *
import System
from System.IO import Directory

# The inputs to this node will be stored as a list in the IN variables.
dataEnteringNode = IN

# Place your code below this line
dir="D:\\aa\\Original_DAS"
filename=(str("Floor"+".csv"))
output=[]
parameters=[]
j=0
for categories in IN[0]:
   i=0
   for families in categories:
      #if j!=1:
      output.append([IN[k][j][i] for k in range(2)]+[IN[2][j]]+[IN[k][j][i] for k in range(3,12)])
      #if j==1:
#         output.append([IN[k][j][i] for k in range(11)]+[IN[11][i]]+[IN[12][i]])
      i=i+1
   j=j+1
      
with open(dir+"\\"+filename,'w',newline='') as fd:
   writer=csv.writer(fd)
   for x in output:
      writer.writerow(x)  
   
   
# Assidgn your output to the OUT variable.
OUT = output
# ----------------------------------------
watch_11 = Watch(python_script)
code_block_19 = CodeBlock { Con_Type=["PU foam","Mortar","Screwed","Dowel","Fixed","Bolted","Nailed"]; }
watch_12 = Watch(valueAtKey)
flatten_5 = List.Flatten()  # unwired: list
contains_12 = String.Contains(str=name_5, searchFor=code_block_10.out1)
string_6 = StringInput("Length")
sum_6 = Math.Sum()  # unwired: values
