# Dynamo graph interor_v6.dyn (Dynamo 2.10.1.3976)
# packages: Rhythm 2021.7.3, Clockwork for Dynamo 2.x 2.3.0

# group: Putting the D-Score, R-Score & DAS into the model for each instance
code_block = CodeBlock { 0; 1; }
list_of_instances = List.Slice(start=code_block.out0, end=code_block.out1)  # unwired: list
code_block_2 = CodeBlock { 1; 2; }
list_of_d_score = List.Slice(start=code_block_2.out0, end=code_block_2.out1)  # unwired: list
ʳʰʸᵗʰᵐ_elements = Rhythm.Revit.Elements.Elements.SetParameterByNameTypeOrInstance(element=list_of_instances, value=list_of_d_score)  # unwired: parameterName
code_block_3 = CodeBlock { 2; 3; }
list_of_r_score = List.Slice(start=code_block_3.out0, end=code_block_3.out1)  # unwired: list
ʳʰʸᵗʰᵐ_elements_2 = Rhythm.Revit.Elements.Elements.SetParameterByNameTypeOrInstance(element=list_of_instances, value=list_of_r_score)  # unwired: parameterName
code_block_4 = CodeBlock { 3; 4; }
list_of_das = List.Slice(start=code_block_4.out0, end=code_block_4.out1)  # unwired: list
ʳʰʸᵗʰᵐ_elements_3 = Rhythm.Revit.Elements.Elements.SetParameterByNameTypeOrInstance(element=list_of_instances, value=list_of_das)  # unwired: parameterName

# group: Calling Plumbing Fixtures Families and Instances
categories = Categories("OST_PlumbingFixtures")
all_family_types_of_category = Custom[All Family Types Of Category](category=categories)  # package Clockwork for Dynamo 2.x; Gets all family types/symbols of a given category in the model.
familyName = Custom[FamilyType.FamilyName](familyType=all_family_types_of_category)  # package Clockwork for Dynamo 2.x; Returns the *family* name of a given family *type*
code_block_5 = CodeBlock { "T12"; }
contains = String.Contains(str=familyName, searchFor=code_block_5)
filterByBoolMask = List.FilterByBoolMask(list=all_family_types_of_category, mask=contains)
all_elements_of_family_type = Custom[All Elements of Family Type+](familyType=filterByBoolMask.in)  # package Clockwork for Dynamo 2.x; Unlike the built-in node, this node retrieves all placed instances of a given loadable *or* system family type

# group: Calling Pipe Families and Instances
categories_2 = Categories("OST_PipeCurves")
all_family_types_of_category_2 = Custom[All Family Types Of Category](category=categories_2)
name = FamilyType.Name(familyType=all_family_types_of_category_2)
code_block_6 = CodeBlock { "T12"; }
contains_2 = String.Contains(str=name, searchFor=code_block_6)
filterByBoolMask_2 = List.FilterByBoolMask(list=all_family_types_of_category_2, mask=contains_2)
all_elements_of_family_type_2 = Custom[All Elements of Family Type+](familyType=filterByBoolMask_2.in)

# group: Calling Wall Families and Instances
categories_3 = Categories("OST_Walls")
all_family_types_of_category_3 = Custom[All Family Types Of Category](category=categories_3)
name_2 = FamilyType.Name(familyType=all_family_types_of_category_3)
code_block_7 = CodeBlock { "T12"; }
contains_3 = String.Contains(str=name_2, searchFor=code_block_7)
filterByBoolMask_3 = List.FilterByBoolMask(list=all_family_types_of_category_3, mask=contains_3)
all_elements_of_family_type_3 = Custom[All Elements of Family Type+](familyType=filterByBoolMask_3.in)

# group: Interior_Connections
categories_4 = Categories("OST_StructConnections")
all_family_types_of_category_4 = Custom[All Family Types Of Category](category=categories_4)
name_3 = FamilyType.Name(familyType=all_family_types_of_category_4)
code_block_8 = CodeBlock { "DAS"; }
contains_4 = String.Contains(str=name_3, searchFor=code_block_8)
filterByBoolMask_4 = List.FilterByBoolMask(list=all_family_types_of_category_4, mask=contains_4)
all_elements_of_family_type_4 = Custom[All Elements of Family Type+](familyType=filterByBoolMask_4.in)
count = List.Count(list=all_elements_of_family_type_4)

# group: Interior_Walls
categories_5 = Categories("OST_Walls")
all_family_types_of_category_5 = Custom[All Family Types Of Category](category=categories_5)
name_4 = FamilyType.Name(familyType=all_family_types_of_category_5)
code_block_9 = CodeBlock { "DAS"; }
contains_5 = String.Contains(str=name_4, searchFor=code_block_9)
filterByBoolMask_5 = List.FilterByBoolMask(list=all_family_types_of_category_5, mask=contains_5)
all_elements_of_family_type_5 = Custom[All Elements of Family Type+](familyType=all_family_types_of_category_5)
string = StringInput("Area")
getParameterValueByName = Element.GetParameterValueByName(element=all_elements_of_family_type_5, parameterName=string)

name_5 = Family.Name(family=filterByBoolMask_5.in)

# group: Interior_Doors
categories_6 = Categories("OST_Doors")
all_family_types_of_category_6 = Custom[All Family Types Of Category](category=categories_6)
all_elements_of_family_type_6 = Custom[All Elements of Family Type+](familyType=all_family_types_of_category_6)
count_2 = List.Count(list=all_elements_of_family_type_6@L1)
string_from_object = FromObject(object=all_family_types_of_category_6)
code_block_10 = CodeBlock { "DAS"; }
contains_6 = String.Contains(str=string_from_object, searchFor=code_block_10)
filterByBoolMask_6 = List.FilterByBoolMask(list=all_family_types_of_category_6, mask=contains_6)

sum = Math.Sum(values=count_2)
watch = Watch(sum)
flatten = List.Flatten(list=getParameterValueByName)
code_block_11 = CodeBlock(a=flatten) { a==""?0:a; }

# group (continued): Interior_Walls
sum_2 = Math.Sum(values=code_block_11)

# group: Interior_Runners
all_elements_of_family_type_7 = Custom[All Elements of Family Type+](familyType=all_family_types_of_category_5)
string_2 = StringInput("Length")
getParameterValueByName_2 = Element.GetParameterValueByName(element=all_elements_of_family_type_7, parameterName=string_2)
categories_7 = Categories("OST_StructuralFraming")
all_family_types_of_category_7 = Custom[All Family Types Of Category](category=categories_7)
name_6 = FamilyType.Name(familyType=all_family_types_of_category_7)
code_block_12 = CodeBlock { "DAS"; }
contains_7 = String.Contains(str=name_6, searchFor=code_block_12)
filterByBoolMask_7 = List.FilterByBoolMask(list=all_family_types_of_category_7, mask=contains_7)

code_block_13 = CodeBlock(a=getParameterValueByName_2) { a=="" ?0:a; }

# group (continued): Interior_Runners
sum_3 = Math.Sum(values=code_block_13@L1)

sum_4 = Math.Sum(values=sum_3)

# group: Families & Quantities
list_create = List.Create(item0=sum, item1=sum_2, item2=sum_4)
list_create_2 = List.Create(item0=filterByBoolMask_6.in, item1=filterByBoolMask_5.in, item2=filterByBoolMask_7.in)

watch_2 = Watch(list_create)
watch_3 = Watch(all_family_types_of_category_5)
watch_4 = Watch(getParameterValueByName)
if_ = If()  # unwired: test, true, false

# group: Parameter Value Generator
code_block_14 = CodeBlock(Family_List=list_create_2)
# ---------- code_block_14.designscript (8 lines) ----------
D_Conn = Elements.GetParameterValueByNameTypeOrInstance(Family_List, "DECONST_Connection_Type");
D_Move = Elements.GetParameterValueByNameTypeOrInstance(Family_List, "DECONST_Moveability");
D_Pref = Elements.GetParameterValueByNameTypeOrInstance(Family_List, "DECONST_Prefabrication");
D_Tool = Elements.GetParameterValueByNameTypeOrInstance(Family_List, "DECONST_Tools");
R_Ruse = Elements.GetParameterValueByNameTypeOrInstance(Family_List, "RECOVER_Reusability");
R_Secf = Elements.GetParameterValueByNameTypeOrInstance(Family_List, "RECOVER_Secondary_Finishing");
R_Toxi = Elements.GetParameterValueByNameTypeOrInstance(Family_List, "RECOVER_Toxicity");
R_Recy = Elements.GetParameterValueByNameTypeOrInstance(Family_List, "RECOVER_Recyclability");
# ----------------------------------------

# group: Scoring Section from Dictionary
name_7 = Family.Name(family=list_create_2)
file_path = Filename(".\Dictionary.xlsx")
file_from_path = FileObject(path=file_path)
code_block_15 = CodeBlock { "Interior"; "Scores_Original_DAS"; }
importExcel = Data.ImportExcel(file=file_from_path, sheetName=code_block_15.out0)
code_block_16 = CodeBlock { 0; 1; }
getItemAtIndex = List.GetItemAtIndex(list=importExcel, index=code_block_16.out0)
getItemAtIndex_2 = List.GetItemAtIndex(list=importExcel, index=code_block_16.out1)
byKeysValues = DesignScript.Builtin.Dictionary.ByKeysValues(keys=getItemAtIndex, values=getItemAtIndex_2)
valueAtKey = DesignScript.Builtin.Dictionary.ValueAtKey(dictionary=byKeysValues, key=name_7)
importExcel_2 = Data.ImportExcel(file=file_from_path, sheetName=code_block_15.out1)
getItemAtIndex_3 = List.GetItemAtIndex(list=importExcel_2, index=code_block_16.out0)
getItemAtIndex_4 = List.GetItemAtIndex(list=importExcel_2, index=code_block_16.out1)
byKeysValues_2 = DesignScript.Builtin.Dictionary.ByKeysValues(keys=getItemAtIndex_3, values=getItemAtIndex_4)
valueAtKey_2 = DesignScript.Builtin.Dictionary.ValueAtKey(dictionary=byKeysValues_2, key=code_block_14.D_Conn)
code_block_17 = CodeBlock(dictionary1=byKeysValues_2, t1=code_block_14.D_Move) { t2 = Dictionary.ValueAtKey(dictionary1, t1); }
valueAtKey_3 = DesignScript.Builtin.Dictionary.ValueAtKey(dictionary=byKeysValues_2, key=code_block_14.D_Tool)

code_block_18 = CodeBlock(b=code_block_14.R_Secf, d=code_block_14.R_Toxi) { a=1-b; c=1-d; }

# group: Parameter Value Generator
code_block_19 = CodeBlock(Family_List2=filterByBoolMask_5.in)
# ---------- code_block_19.designscript (2 lines) ----------
D_Conn = Elements.GetParameterValueByNameTypeOrInstance(Family_List2, "RECOVER_Recyclability_WallBoard");
D_Move = Elements.GetParameterValueByNameTypeOrInstance(Family_List2, "RECOVER_Reusability_WallBoard");
# ----------------------------------------

python_script = Python(IN[0]=name_7, IN[1]=valueAtKey, IN[2]=list_create, IN[3]=code_block_14.D_Conn, IN[4]=valueAtKey_2, IN[5]=code_block_17, IN[6]=code_block_14.D_Pref, IN[7]=valueAtKey_3, IN[8]=code_block_14.R_Ruse, IN[9]=code_block_18.a, IN[10]=code_block_18.c, IN[11]=code_block_14.R_Recy, IN[12]=code_block_19.D_Conn, IN[13]=code_block_19.D_Move)  # CPython3
# ---------- python_script.python (36 lines) ----------
# Load the Python Standard and DesignScript Libraries
import sys
import clr
import csv
clr.AddReference('ProtoGeometry')
from Autodesk.DesignScript.Geometry import *
import System
from System.IO import Directory

# The inputs to this node will be stored as a list in the IN variables.
dataEnteringNode = IN

# Place your code below this line
dir="D:\\aa\\Original_DAS"
filename=(str("Interior"+".csv"))
output=[]
parameters=[]
j=0
for categories in IN[0]:
   i=0
   for families in categories:
      if j!=1:
         output.append([IN[k][j][i] for k in range(2)]+[IN[2][j]]+[IN[k][j][i] for k in range(3,12)])
      if j==1:
         output.append([IN[k][j][i] for k in range(2)]+[IN[2][j]]+[IN[k][j][i] for k in range(3,12)]+[IN[12][i]]+[IN[13][i]])
      i=i+1
   j=j+1
      
with open(dir+"\\"+filename,'w',newline='') as fd:
   writer=csv.writer(fd)
   for x in output:
      writer.writerow(x)  
   
   
# Assidgn your output to the OUT variable.
OUT = output
# ----------------------------------------
watch_5 = Watch(python_script)
