# Dynamo graph roofing.Truss_V6.dyn (Dynamo 2.10.1.3976)
# packages: Clockwork for Dynamo 2.x 2.3.0

# group: Calling Plumbing Fixtures Families and Instances
categories = Categories("OST_PlumbingFixtures")
all_family_types_of_category = Custom[All Family Types Of Category](category=categories)  # package Clockwork for Dynamo 2.x; Gets all family types/symbols of a given category in the model.
familyName = Custom[FamilyType.FamilyName](familyType=all_family_types_of_category)  # package Clockwork for Dynamo 2.x; Returns the *family* name of a given family *type*
code_block = CodeBlock { "T12"; }
contains = String.Contains(str=familyName, searchFor=code_block)
filterByBoolMask = List.FilterByBoolMask(list=all_family_types_of_category, mask=contains)
all_elements_of_family_type = Custom[All Elements of Family Type+](familyType=filterByBoolMask.in)  # package Clockwork for Dynamo 2.x; Unlike the built-in node, this node retrieves all placed instances of a given loadable *or* system family type

# group: Calling Pipe Families and Instances
categories_2 = Categories("OST_PipeCurves")
all_family_types_of_category_2 = Custom[All Family Types Of Category](category=categories_2)
name = FamilyType.Name(familyType=all_family_types_of_category_2)
code_block_2 = CodeBlock { "T12"; }
contains_2 = String.Contains(str=name, searchFor=code_block_2)
filterByBoolMask_2 = List.FilterByBoolMask(list=all_family_types_of_category_2, mask=contains_2)
all_elements_of_family_type_2 = Custom[All Elements of Family Type+](familyType=filterByBoolMask_2.in)

# group: Calling Wall Families and Instances
categories_3 = Categories("OST_Walls")
all_family_types_of_category_3 = Custom[All Family Types Of Category](category=categories_3)
name_2 = FamilyType.Name(familyType=all_family_types_of_category_3)
code_block_3 = CodeBlock { "T12"; }
contains_3 = String.Contains(str=name_2, searchFor=code_block_3)
filterByBoolMask_3 = List.FilterByBoolMask(list=all_family_types_of_category_3, mask=contains_3)
all_elements_of_family_type_3 = Custom[All Elements of Family Type+](familyType=filterByBoolMask_3.in)

code_block_4 = CodeBlock { " "; "Walls"; "Windows"; "Doors"; "Studs"; "Stud Connections"; }
list_create = List.Create(item0=code_block_4.out0, item1=code_block_4.out1, item2=code_block_4.out2, item3=code_block_4.out3, item4=code_block_4.out4, item5=code_block_4.out5)
code_block_5 = CodeBlock { "D Score"; }
addItemToFront = List.AddItemToFront(item=code_block_5)  # unwired: list
code_block_6 = CodeBlock { "R Score"; }
addItemToFront_2 = List.AddItemToFront(item=code_block_6)  # unwired: list
code_block_7 = CodeBlock { "DAS Score"; }
addItemToFront_3 = List.AddItemToFront(item=code_block_7)  # unwired: list
list_create_2 = List.Create(item0=list_create, item1=addItemToFront, item2=addItemToFront_2, item3=addItemToFront_3)
transpose = List.Transpose(lists=addItemToFront_3@@L2)
watch = Watch(transpose)
file_path = Filename("..\csvoutput.csv")
exportCSV = Data.ExportCSV(filePath=file_path@@L1)  # unwired: data
watch_2 = Watch(exportCSV)

# group: Calling Structure framing Families and Instances
categories_4 = Categories("OST_StructuralFramingSystem")
all_family_types_of_category_4 = Custom[All Family Types Of Category](category=categories_4)
code_block_8 = CodeBlock { "DAS_Truss"; }

name_3 = Family.Name(family=all_family_types_of_category_4)

# group (continued): Calling Structure framing Families and Instances
contains_4 = String.Contains(str=name_3, searchFor=code_block_8)
filterByBoolMask_4 = List.FilterByBoolMask(list=all_family_types_of_category_4, mask=contains_4)

categories_5 = Categories("OST_StructuralTruss")
all_elements_of_category = ElementsOfCategory(Category=categories_5)
code_block_9 = CodeBlock { "Total length of truss members"; }
getParameterValueByName = Element.GetParameterValueByName(element=all_elements_of_category, parameterName=code_block_9)
sum = Math.Sum(values=getParameterValueByName)

# group: Families & Quantities
list_create_3 = List.Create(item0=filterByBoolMask_4.in)
list_create_4 = List.Create(item0=sum)

name_4 = Family.Name(family=list_create_3)

# group: Parameter Value Generator
code_block_10 = CodeBlock(Family_List=list_create_3)
# ---------- code_block_10.designscript (8 lines) ----------
D_Conn = Elements.GetParameterValueByNameTypeOrInstance(Family_List, "DECONST_Connection_Type");
D_Move = Elements.GetParameterValueByNameTypeOrInstance(Family_List, "DECONST_Moveability");
D_Pref = Elements.GetParameterValueByNameTypeOrInstance(Family_List, "DECONST_Prefabrication");
D_Tool = Elements.GetParameterValueByNameTypeOrInstance(Family_List, "DECONST_Tools");
R_Ruse = Elements.GetParameterValueByNameTypeOrInstance(Family_List, "RECOVER_Reusability");
R_Secf = Elements.GetParameterValueByNameTypeOrInstance(Family_List, "RECOVER_Secondary_Finishing");
R_Toxi = Elements.GetParameterValueByNameTypeOrInstance(Family_List, "RECOVER_Toxicity");
R_Recy = Elements.GetParameterValueByNameTypeOrInstance(Family_List, "RECOVER_Recyclability");
# ----------------------------------------

# group: Scoring & Weighting Dictionary
file_path_2 = Filename("Original_DAS\Dictionary.xlsx")
file_from_path = FileObject(path=file_path_2)
code_block_11 = CodeBlock { "Scores_Original_DAS"; "Roof"; }
code_block_12 = CodeBlock { 0; 1; }
importExcel = Data.ImportExcel(file=file_from_path, sheetName=code_block_11.out0)
getItemAtIndex = List.GetItemAtIndex(list=importExcel, index=code_block_12.out0)
getItemAtIndex_2 = List.GetItemAtIndex(list=importExcel, index=code_block_12.out1)
byKeysValues = DesignScript.Builtin.Dictionary.ByKeysValues(keys=getItemAtIndex, values=getItemAtIndex_2)
valueAtKey = DesignScript.Builtin.Dictionary.ValueAtKey(dictionary=byKeysValues, key=code_block_10.D_Conn)

importExcel_2 = Data.ImportExcel(file=file_from_path, sheetName=code_block_11.out1)
getItemAtIndex_3 = List.GetItemAtIndex(list=importExcel_2, index=code_block_12.out0)
getItemAtIndex_4 = List.GetItemAtIndex(list=importExcel_2, index=code_block_12.out1)
byKeysValues_2 = DesignScript.Builtin.Dictionary.ByKeysValues(keys=getItemAtIndex_3, values=getItemAtIndex_4)
valueAtKey_2 = DesignScript.Builtin.Dictionary.ValueAtKey(dictionary=byKeysValues_2, key=name_4)
code_block_13 = CodeBlock(dictionary1=byKeysValues, t1=code_block_10.D_Move) { t2 = Dictionary.ValueAtKey(dictionary1, t1); }
valueAtKey_3 = DesignScript.Builtin.Dictionary.ValueAtKey(dictionary=byKeysValues, key=code_block_10.D_Tool)
code_block_14 = CodeBlock(b=code_block_10.R_Secf, d=code_block_10.R_Toxi) { a=1-b; c=1-d; }
python_script = Python(IN[0]=name_4, IN[1]=valueAtKey_2, IN[2]=list_create_4, IN[3]=code_block_10.D_Conn, IN[4]=valueAtKey, IN[5]=code_block_13, IN[6]=code_block_10.D_Pref, IN[7]=valueAtKey_3, IN[8]=code_block_10.R_Ruse, IN[9]=code_block_14.a, IN[10]=code_block_14.c, IN[11]=code_block_10.R_Recy)  # CPython3
# ---------- python_script.python (36 lines) ----------
# Load the Python Standard and DesignScript Libraries
import sys
import clr
import csv
clr.AddReference('ProtoGeometry')
from Autodesk.DesignScript.Geometry import *
import System
from System.IO import Directory

# The inputs to this node will be stored as a list in the IN variables.
dataEnteringNode = IN

# Place your code below this line
dir="D:\\aa\\Original_DAS"
filename=(str("Roof_Truss"+".csv"))
output=[]
parameters=[]
j=0
for categories in IN[0]:
   i=0
   for families in categories:
      #if j!=1:
      output.append([IN[k][j][i] for k in range(2)]+[IN[2][j]]+[IN[k][j][i] for k in range(3,12)])
      #if j==1:
#         output.append([IN[k][j][i] for k in range(11)]+[IN[11][i]]+[IN[12][i]])
      i=i+1
   j=j+1
      
with open(dir+"\\"+filename,'w',newline='') as fd:
   writer=csv.writer(fd)
   for x in output:
      writer.writerow(x)  
   
   
# Assidgn your output to the OUT variable.
OUT = output
# ----------------------------------------
watch_3 = Watch(python_script)
code_block_15 = CodeBlock { Con_Type=["PU foam","Mortar","Screwed","Dowel","Fixed","Bolted","Nailed"]; }
watch_4 = Watch(code_block_10.D_Tool)
watch_5 = Watch(valueAtKey)
watch_6 = Watch(name_4)

# group: Roof_Cover
categories_6 = Categories("OST_Roofs")
all_family_types_of_category_5 = Custom[All Family Types Of Category](category=categories_6)
string_from_object = FromObject(object=all_family_types_of_category_5)
code_block_16 = CodeBlock { "DAS"; }
contains_5 = String.Contains(str=string_from_object, searchFor=code_block_16)
filterByBoolMask_5 = List.FilterByBoolMask(list=all_family_types_of_category_5, mask=contains_5)
all_elements_of_family_type_4 = Custom[All Elements of Family Type+](familyType=filterByBoolMask_5.in)
string = StringInput("Area")
getParameterValueByName_2 = Element.GetParameterValueByName(element=all_elements_of_family_type_4, parameterName=string)
code_block_17 = CodeBlock(item=getParameterValueByName_2) { item!="" ? item:0; }
sum_2 = Math.Sum(values=code_block_17)

watch_7 = Watch(all_family_types_of_category_4)
all_elements_of_family_type_5 = Custom[All Elements of Family Type+](familyType=all_family_types_of_category_4)
name_5 = Family.Name(family=all_elements_of_category)
string_2 = StringInput("tSpan")
