# Dynamo graph roofing.raftersv6.dyn (Dynamo 2.10.1.3976)
# packages: Clockwork for Dynamo 2.x 2.3.0

# group: Calling Plumbing Fixtures Families and Instances
categories = Categories("OST_PlumbingFixtures")
all_family_types_of_category = Custom[All Family Types Of Category](category=categories)  # package Clockwork for Dynamo 2.x; Gets all family types/symbols of a given category in the model.
familyName = Custom[FamilyType.FamilyName](familyType=all_family_types_of_category)  # package Clockwork for Dynamo 2.x; Returns the *family* name of a given family *type*
code_block = CodeBlock { "T12"; }
contains = String.Contains(str=familyName, searchFor=code_block)
filterByBoolMask = List.FilterByBoolMask(list=all_family_types_of_category, mask=contains)
all_elements_of_family_type = Custom[All Elements of Family Type+](familyType=filterByBoolMask.in)  # package Clockwork for Dynamo 2.x; Unlike the built-in node, this node retrieves all placed instances of a given loadable *or* system family type

# group: Calling Pipe Families and Instances
categories_2 = Categories("OST_PipeCurves")
all_family_types_of_category_2 = Custom[All Family Types Of Category](category=categories_2)
name = FamilyType.Name(familyType=all_family_types_of_category_2)
code_block_2 = CodeBlock { "T12"; }
contains_2 = String.Contains(str=name, searchFor=code_block_2)
filterByBoolMask_2 = List.FilterByBoolMask(list=all_family_types_of_category_2, mask=contains_2)
all_elements_of_family_type_2 = Custom[All Elements of Family Type+](familyType=filterByBoolMask_2.in)

# group: Calling Wall Families and Instances
categories_3 = Categories("OST_Walls")
all_family_types_of_category_3 = Custom[All Family Types Of Category](category=categories_3)
name_2 = FamilyType.Name(familyType=all_family_types_of_category_3)
code_block_3 = CodeBlock { "T12"; }
contains_3 = String.Contains(str=name_2, searchFor=code_block_3)
filterByBoolMask_3 = List.FilterByBoolMask(list=all_family_types_of_category_3, mask=contains_3)
all_elements_of_family_type_3 = Custom[All Elements of Family Type+](familyType=filterByBoolMask_3.in)

string = StringInput("Span")
getParameterValueByName = Element.GetParameterValueByName(parameterName=string)  # unwired: element
watch = Watch(getParameterValueByName)
sum = Math.Sum(values=getParameterValueByName)
watch_2 = Watch(sum)
count = List.Count()  # unwired: list
byKeysValues = DesignScript.Builtin.Dictionary.ByKeysValues()  # unwired: keys, values
watch_3 = Watch()  # unwired: arg0
all_families_of_category = Custom[All Families Of Category]()  # package Clockwork for Dynamo 2.x; Gets all famiies of a given category in the model (does *not *work for system families); unwired: category
all_elements_of_category = ElementsOfCategory()  # unwired: Category

# group: Calling Structure framing Families and Instances
categories_4 = Categories("OST_StructuralFraming")
all_family_types_of_category_4 = Custom[All Family Types Of Category](category=categories_4)
string_from_object = FromObject(object=all_family_types_of_category_4)
code_block_4 = CodeBlock { "DAS_Rafters"; }
contains_4 = String.Contains(str=string_from_object, searchFor=code_block_4)
filterByBoolMask_4 = List.FilterByBoolMask(list=all_family_types_of_category_4, mask=contains_4)

string_from_object_2 = FromObject(object=filterByBoolMask_4.in)
string_2 = StringInput("Length")
getParameterValueByName_2 = Element.GetParameterValueByName(parameterName=string_2)  # unwired: element
sum_2 = Math.Sum(values=getParameterValueByName_2)
string_from_object_3 = FromObject()  # unwired: object
code_block_5 = CodeBlock { "Flange"; }
contains_5 = String.Contains(str=string_from_object_3, searchFor=code_block_5)
filterByBoolMask_5 = List.FilterByBoolMask(mask=contains_5)  # unwired: list
watch_4 = Watch(filterByBoolMask_5.in)

# group: Calling Columns Families and Instances
categories_5 = Categories("OST_Columns")
all_family_types_of_category_5 = Custom[All Family Types Of Category](category=categories_5)
string_from_object_4 = FromObject(object=all_family_types_of_category_5)
code_block_6 = CodeBlock { "Team"; }
contains_6 = String.Contains(str=string_from_object_4, searchFor=code_block_6)
filterByBoolMask_6 = List.FilterByBoolMask(list=all_family_types_of_category_5, mask=contains_6)
all_elements_of_family_type_4 = Custom[All Elements of Family Type+](familyType=filterByBoolMask_6.in)

string_3 = StringInput("Area")
getParameterValueByName_3 = Element.GetParameterValueByName(element=all_elements_of_family_type_4, parameterName=string_3)
sum_3 = Math.Sum(values=getParameterValueByName_3)
watch_5 = Watch(filterByBoolMask_6.in)
watch_6 = Watch()  # unwired: arg0
categories_6 = Categories("OST_Walls")
all_family_types_of_category_6 = Custom[All Family Types Of Category](category=categories_6)
name_3 = FamilyType.Name(familyType=all_family_types_of_category_6)
code_block_7 = CodeBlock { "T12"; }
contains_7 = String.Contains(str=name_3, searchFor=code_block_7)
filterByBoolMask_7 = List.FilterByBoolMask(list=all_family_types_of_category_6, mask=contains_7)
all_elements_of_family_type_5 = Custom[All Elements of Family Type+](familyType=filterByBoolMask_7.in)
string_4 = StringInput("Area")
getParameterValueByName_4 = Element.GetParameterValueByName(element=all_elements_of_family_type_5, parameterName=string_4)
watch_7 = Watch(getParameterValueByName_4)
sum_4 = Math.Sum(values=getParameterValueByName_4)
watch_8 = Watch(sum_4)

# group: Calling Doors Families and Instances
categories_7 = Categories("OST_Roofs")
all_family_types_of_category_7 = Custom[All Family Types Of Category](category=categories_7)
string_from_object_5 = FromObject(object=all_family_types_of_category_7)
code_block_8 = CodeBlock { "T12"; }
contains_8 = String.Contains(str=string_from_object_5, searchFor=code_block_8)
filterByBoolMask_8 = List.FilterByBoolMask(list=all_family_types_of_category_7, mask=contains_8)
all_elements_of_family_type_6 = Custom[All Elements of Family Type+](familyType=filterByBoolMask_8.in)

# group: Creating List of Families
list_create = List.Create(item0=filterByBoolMask_8.in, item1=filterByBoolMask_7.in)

watch_9 = Watch(list_create)
code_block_9 = CodeBlock {  }
watch_10 = Watch()  # unwired: arg0
count_2 = List.Count(list=all_elements_of_family_type_6@L2)
list_create_2 = List.Create(item0=count_2, item1=sum_4)
watch_11 = Watch(list_create_2)
byKeysValues_2 = DesignScript.Builtin.Dictionary.ByKeysValues()  # unwired: keys, values
all_elements_of_category_2 = ElementsOfCategory(Category=categories_7)
watch_12 = Watch(all_elements_of_category_2)

# group: Roof_Cover
categories_8 = Categories("OST_Roofs")
all_family_types_of_category_8 = Custom[All Family Types Of Category](category=categories_8)
all_elements_of_family_type_7 = Custom[All Elements of Family Type+](familyType=all_family_types_of_category_8)
string_5 = StringInput("Area")
getParameterValueByName_5 = Element.GetParameterValueByName(element=all_elements_of_family_type_7, parameterName=string_5)
code_block_10 = CodeBlock(item=getParameterValueByName_5) { item!="" ? item:0; }
string_from_object_6 = FromObject(object=all_family_types_of_category_8)
code_block_11 = CodeBlock { "DAS"; }
contains_9 = String.Contains(str=string_from_object_6, searchFor=code_block_11)
filterByBoolMask_9 = List.FilterByBoolMask(list=all_family_types_of_category_8, mask=contains_9)

flatten = List.Flatten(list=code_block_10)

# group (continued): Roof_Cover
sum_5 = Math.Sum(values=flatten)

code_block_12 = CodeBlock { "M_Timber"; }
contains_10 = String.Contains(str=string_from_object, searchFor=[code_block_12, code_block_12])
filterByBoolMask_10 = List.FilterByBoolMask(list=all_family_types_of_category_4, mask=contains_10)
all_elements_of_family_type_8 = ElementsOfFamilyType(Family_Type=filterByBoolMask_10.in)
string_6 = StringInput("Length")
getParameterValueByName_6 = Element.GetParameterValueByName(element=all_elements_of_family_type_8, parameterName=string_6)
flatten_2 = List.Flatten(list=getParameterValueByName_6)
code_block_13 = CodeBlock(item=flatten_2) { item!="" ? item:0; }
sum_6 = Math.Sum(values=code_block_13)

# group: Families & Quantities
list_create_3 = List.Create(item0=sum_5, item1=sum_6)
list_create_4 = List.Create(item0=filterByBoolMask_9.in, item1=filterByBoolMask_4.in)

watch_13 = Watch(list_create_3)
name_4 = Family.Name(family=list_create_4)

# group: Parameter Value Generator
code_block_14 = CodeBlock(Family_List2=filterByBoolMask_9.in)
# ---------- code_block_14.designscript (14 lines) ----------
Elements.GetParameterValueByNameTypeOrInstance(Family_List2, "DECONST_Connection_Type");
Elements.GetParameterValueByNameTypeOrInstance(Family_List2, "DECONST_Moveability");
Elements.GetParameterValueByNameTypeOrInstance(Family_List2, "DECONST_Prefabrication");
Elements.GetParameterValueByNameTypeOrInstance(Family_List2, "DECONST_Tools");
Elements.GetParameterValueByNameTypeOrInstance(Family_List2, "RECOVER_Secondary_Finishing");
Elements.GetParameterValueByNameTypeOrInstance(Family_List2, "RECOVER_Recyclability_Cover");
Elements.GetParameterValueByNameTypeOrInstance(Family_List2, "RECOVER_Reusability_Cover");
Elements.GetParameterValueByNameTypeOrInstance(Family_List2, "RECOVER_Toxicity_Covering");
Elements.GetParameterValueByNameTypeOrInstance(Family_List2, "RECOVER_Recyclability_Sheathing");
Elements.GetParameterValueByNameTypeOrInstance(Family_List2, "RECOVER_Reusability_Sheathing");
Elements.GetParameterValueByNameTypeOrInstance(Family_List2, "RECOVER_Toxicity_Sheathing");
Elements.GetParameterValueByNameTypeOrInstance(Family_List2, "RECOVER_Recyclability_Insulation");
Elements.GetParameterValueByNameTypeOrInstance(Family_List2, "RECOVER_Reusability_Insulation");
Elements.GetParameterValueByNameTypeOrInstance(Family_List2, "RECOVER_Toxicity_Insulation");
# ----------------------------------------

# group: Parameter Value Generator
code_block_15 = CodeBlock(Family_List=filterByBoolMask_4.in)
# ---------- code_block_15.designscript (8 lines) ----------
Elements.GetParameterValueByNameTypeOrInstance(Family_List, "DECONST_Connection_Type");
Elements.GetParameterValueByNameTypeOrInstance(Family_List, "DECONST_Moveability");
Elements.GetParameterValueByNameTypeOrInstance(Family_List, "DECONST_Prefabrication");
Elements.GetParameterValueByNameTypeOrInstance(Family_List, "DECONST_Tools");
Elements.GetParameterValueByNameTypeOrInstance(Family_List, "RECOVER_Reusability");
Elements.GetParameterValueByNameTypeOrInstance(Family_List, "RECOVER_Secondary_Finishing");
Elements.GetParameterValueByNameTypeOrInstance(Family_List, "RECOVER_Toxicity");
Elements.GetParameterValueByNameTypeOrInstance(Family_List, "RECOVER_Recyclability");
# ----------------------------------------

list_create_5 = List.Create(item0=code_block_14.out0, item1=code_block_15.out0)

# group: Scoring & Weighting Dictionary
file_path = Filename(".\Dictionary.xlsx")
file_from_path = FileObject(path=file_path)
code_block_16 = CodeBlock { "Scores_Original_DAS"; "Roof"; }
code_block_17 = CodeBlock { 0; 1; }
importExcel = Data.ImportExcel(file=file_from_path, sheetName=code_block_16.out0)
getItemAtIndex = List.GetItemAtIndex(list=importExcel, index=code_block_17.out0)
getItemAtIndex_2 = List.GetItemAtIndex(list=importExcel, index=code_block_17.out1)
byKeysValues_3 = DesignScript.Builtin.Dictionary.ByKeysValues(keys=getItemAtIndex, values=getItemAtIndex_2)
valueAtKey = DesignScript.Builtin.Dictionary.ValueAtKey(dictionary=byKeysValues_3, key=list_create_5)

importExcel_2 = Data.ImportExcel(file=file_from_path, sheetName=code_block_16.out1)
getItemAtIndex_3 = List.GetItemAtIndex(list=importExcel_2, index=code_block_17.out0)
getItemAtIndex_4 = List.GetItemAtIndex(list=importExcel_2, index=code_block_17.out1)
byKeysValues_4 = DesignScript.Builtin.Dictionary.ByKeysValues(keys=getItemAtIndex_3, values=getItemAtIndex_4)
valueAtKey_2 = DesignScript.Builtin.Dictionary.ValueAtKey(dictionary=byKeysValues_4, key=name_4)
list_create_6 = List.Create(item0=code_block_14.out1, item1=code_block_15.out1)
valueAtKey_3 = DesignScript.Builtin.Dictionary.ValueAtKey(dictionary=byKeysValues_3, key=list_create_6)
list_create_7 = List.Create(item0=code_block_14.out2, item1=code_block_15.out2)
list_create_8 = List.Create(item0=code_block_14.out3, item1=code_block_15.out3)
valueAtKey_4 = DesignScript.Builtin.Dictionary.ValueAtKey(dictionary=byKeysValues_3, key=list_create_8)
list_create_9 = List.Create(item0=code_block_14.out4, item1=code_block_15.out5)
code_block_18 = CodeBlock(b=list_create_9) { a=1-b; }
code_block_19 = CodeBlock(b=code_block_14.out7, d=code_block_14.out10, f=code_block_14.out13) { a=1-b; c=1-d; e=1-f; }
python_script = Python(IN[0]=name_4, IN[1]=valueAtKey_2, IN[2]=list_create_3, IN[3]=list_create_5, IN[4]=valueAtKey, IN[5]=valueAtKey_3, IN[6]=list_create_7, IN[7]=valueAtKey_4, IN[8]=code_block_15.out4, IN[9]=code_block_18, IN[10]=code_block_15.out6, IN[11]=code_block_15.out7, IN[12]=code_block_14.out5, IN[13]=code_block_14.out6, IN[14]=code_block_19.a, IN[15]=code_block_14.out8, IN[16]=code_block_14.out9, IN[17]=code_block_19.c, IN[18]=code_block_14.out11, IN[19]=code_block_14.out12, IN[20]=code_block_19.e)  # CPython3
# ---------- python_script.python (36 lines) ----------
# Load the Python Standard and DesignScript Libraries
import sys
import clr
import csv
clr.AddReference('ProtoGeometry')
from Autodesk.DesignScript.Geometry import *
import System
from System.IO import Directory

# The inputs to this node will be stored as a list in the IN variables.
dataEnteringNode = IN

# Place your code below this line
dir="D:\\aa\\Original_DAS"
filename=(str("Roof_Rafters"+".csv"))
output=[]
parameters=[]
j=0
for categories in IN[0]:
   i=0
   for families in categories:
      if j==0:
         output.append([IN[k][j][i] for k in range(2)]+[IN[2][j]]+[IN[k][j][i] for k in range(3,8)]+[""]+[IN[9][j][i]]+["",""]+[IN[k][i] for k in range(12,21)])
      if j==1:
         output.append([IN[k][j][i] for k in range(2)]+[IN[2][j]]+[IN[k][j][i] for k in range(3,8)]+[IN[8][i]]+[IN[9][j][i]]+[IN[k][i] for k in range(10,12)])
      i=i+1
   j=j+1
      
with open(dir+"\\"+filename,'w',newline='') as fd:
   writer=csv.writer(fd)
   for x in output:
      writer.writerow(x)  
   
   
# Assidgn your output to the OUT variable.
OUT = output
# ----------------------------------------
watch_14 = Watch(python_script)
watch_15 = Watch(valueAtKey_2)
